# Grasshopper definition truss-no-analysis.gh (Grasshopper 1.0.7)

construct_point = ConstructPoint(XCoordinate=0, YCoordinate=0, ZCoordinate=0)

# ---- group: RH_IN:length
number_slider = Slider(20, range=0..100)

# ----
construct_point_2 = ConstructPoint(XCoordinate=number_slider, YCoordinate=0, ZCoordinate=0)

# ---- group: RH_IN:division
number_slider_2 = Slider(6, range=0..10)

# ---- group: RH_IN:initial height
number_slider_3 = Slider(2, range=0..10)

# ---- group: RH_IN:height step
number_slider_4 = Slider(3, range=0..6)

# ---- group: RH_IN:Flange section radius
number_slider_5 = Slider(3, range=1..8)

# ---- group: RH_IN:Diagonal section radius
number_slider_6 = Slider(1, range=1..6)

# ----
number_slider_7 = Slider(10, range=0..10)
line = Line(StartPoint=construct_point, EndPoint=construct_point_2)
divide_curve = DivideCurve(Curve=line, Count="2", Kinks=False)  # -> Points, Tangents, Parameters
division = Division(A=number_slider_4, B=number_slider_7)
division_2 = Division(A=number_slider_5, B=number_slider_7)
division_3 = Division(A=number_slider_6, B=number_slider_7)
shatter = Shatter(Curve=line, Parameters=divide_curve.Parameters)
divide_curve_2 = DivideCurve(Curve=shatter, Count=number_slider_2, Kinks=False)  # -> Points, Tangents, Parameters
unit_z = UnitZ(Factor=number_slider_3)
move = Move(Geometry=divide_curve_2.Points, Motion=unit_z)  # -> Geometry, Transform
panel = Panel("""0
1""")
dispatch = Dispatch(List=move.Geometry, DispatchPattern=panel)  # -> ListA, ListB
point = Point(dispatch.ListB)
list_length = ListLength(List=point)
series = Series(Start="0", Step=division, Count=list_length)  # -> simplify(Series)
explode_tree = ExplodeTree(Data=series)  # -> Branch0, reverse(Branch1)
entwine = Entwine(Branch00=explode_tree.Branch0, Branch01=explode_tree.Branch1, FlattenInputs=True)
unit_z_2 = UnitZ(Factor=entwine)
panel_2 = Panel(entwine)
move_2 = Move(Geometry=point, Motion=unit_z_2)  # -> Geometry, Transform
panel_3 = Panel("""0
1""")
dispatch_2 = Dispatch(List=divide_curve_2.Points, DispatchPattern=panel_3)  # -> ListA, ListB
list_item = ListItem(List=flatten(divide_curve_2.Points), Index=0, Wrap=True)  # -> Item1, Item
list_item_2 = ListItem(List=flatten(move_2.Geometry), Index=0, Wrap=True)  # -> Item1, Item
shift_list = ShiftList(List=move_2.Geometry, Shift=1, Wrap=False)
point_2 = Point(dispatch_2.ListA)
polyline = PolyLine(Vertices=move_2.Geometry, Closed=False)
line_2 = Line(StartPoint=[list_item.Item1, list_item.Item], EndPoint=[list_item_2.Item1, list_item_2.Item])
line_3 = Line(StartPoint=point_2, EndPoint=move_2.Geometry)
line_4 = Line(StartPoint=shift_list, EndPoint=point_2)
curve = Curve(line)
merge = Merge(Data1=curve, Data2=line_2, Data3=polyline)
merge_2 = Merge(Data1=line_3, Data2=line_4)
number_slider_8 = Slider(0.05, range=0..0.1)
pipe = Pipe(Curve=merge, Radius=division_2, Caps=0)
pipe_2 = Pipe(Curve=merge_2, Radius=division_3, Caps=0)
settings_custom = SettingsCustom(
    StitchSeams=True,
    SimplePlanes=False,
    Refine=True,
    MinCount=16,
    MaxCount=400,
    AspectRatio=20,
    MaxDistance=0,
    MaxAngle=20,
    MinEdge=number_slider_8,
    MaxEdge=number_slider_8)
mesh_brep = MeshBrep(Brep=[pipe_2, pipe], Settings=settings_custom)

# ---- group: RH_OUT:edges
medges = MeshEdges(Mesh=mesh_brep)  # -> NakedEdges, InteriorEdges, NonManifoldEdges

# ---- group: RH_OUT:mesh
mesh = Mesh(mesh_brep)
