# Grasshopper definition truss.gh (Grasshopper 1.0.7)
# plug-ins: karambaGH, LunchBox

# ---- group: RH_IN:CrossSection1
number_slider = Slider(80, range=20..150)

# ---- group: RH_IN:CrossSection2
crosssection2 = Slider(59, range=20..150)

# ---- group: RH_IN:Load
number_slider_2 = Slider(20, range=0..50)

# ---- group: RH_IN:length
number_slider_3 = Slider(20, range=0..20)

# ---- group: RH_IN:height step
number_slider_4 = Slider(0.32, range=0..1)

# ---- group: RH_IN:initial height
number_slider_5 = Slider(0.85, range=0.5..10)

# ---- group: RH_IN:division
number_slider_6 = Slider(6, range=0..6)

# ---- group: RH_IN:ShowMesh
boolean_toggle = BooleanToggle(True)

# ----
unit_z = UnitZ(Factor=expr("-1*x", number_slider_2))
construct_point = ConstructPoint(XCoordinate=0, YCoordinate=0, ZCoordinate=0)
construct_point_2 = ConstructPoint(XCoordinate=number_slider_3, YCoordinate=0, ZCoordinate=0)
cross_section_range_selector_karamba3d = CrossSectionRangeSelectorKaramba3D(MaximumHeight_cm=-1, MaximumWidth_cm=-1, ElementsIdentifiers="LOAD", menu=[dropdown(1), dropdown(2), dropdown(1)])
cross_section_range_selector_karamba3d_2 = CrossSectionRangeSelectorKaramba3D(MaximumHeight_cm=-1, MaximumWidth_cm=-1, ElementsIdentifiers="OUT", menu=[dropdown(1), dropdown(2), dropdown(1)])
cross_section_range_selector_karamba3d_3 = CrossSectionRangeSelectorKaramba3D(MaximumHeight_cm=-1, MaximumWidth_cm=-1, ElementsIdentifiers="IN", menu=[dropdown(1), dropdown(2), dropdown(1)])
material_selection_karamba3d = MaterialSelectionKaramba3D(ElementIdentifier="OUT", menu=[dropdown(1), dropdown(2)])
support_karamba3d = SupportKaramba3D(PosInd=construct_point, menu=[buttons(on, on, on, on, on, off)])
support_karamba3d_2 = SupportKaramba3D(PosInd=construct_point_2, menu=[buttons(on, on, on, on, off, off)])
loads_karamba3d = LoadsKaramba3D(Vector=unit_z, BeamIdentifiers="LOAD", LCase="0", mode="Uniform Line", menu=[buttons(off, on, off)])
loads_karamba3d_2 = LoadsKaramba3D(Vector=Vector(0, 0, -1), LCase=0, mode="Gravity")
line = Line(StartPoint=construct_point, EndPoint=construct_point_2)
divide_curve = DivideCurve(Curve=line, Count="2", Kinks=False)  # -> Points, Tangents, Parameters
list_item = ListItem(List=cross_section_range_selector_karamba3d, Index=number_slider, Wrap=True)
list_item_2 = ListItem(List=cross_section_range_selector_karamba3d_2, Index=number_slider, Wrap=True)
list_item_3 = ListItem(List=cross_section_range_selector_karamba3d_3, Index=crosssection2, Wrap=True)
shatter = Shatter(Curve=line, Parameters=divide_curve.Parameters)
divide_curve_2 = DivideCurve(Curve=shatter, Count=number_slider_6, Kinks=False)  # -> Points, Tangents, Parameters
text_split = TextSplit(Text=list_item, Separators=":")
text_split_2 = TextSplit(Text=list_item_3, Separators=":")
unit_z_2 = UnitZ(Factor=number_slider_5)
move = Move(Geometry=divide_curve_2.Points, Motion=unit_z_2)  # -> Geometry, Transform
list_item_4 = ListItem(List=text_split, Index=2, Wrap=True)
list_item_5 = ListItem(List=text_split_2, Index=2, Wrap=True)
text_split_3 = TextSplit(Text=list_item_4, Separators="'")
text_split_4 = TextSplit(Text=list_item_5, Separators="'")
panel = Panel("""0
1""")
dispatch = Dispatch(List=move.Geometry, DispatchPattern=panel)  # -> ListA, ListB
list_item_6 = ListItem(List=text_split_3, Index=1, Wrap=True)  # -> flatten(Item), Item1
text_split_5 = TextSplit(Text=list_item_6.Item, Separators=" ")
text_split_6 = TextSplit(Text=text_split_5, Separators="x")  # -> flatten(Result)
list_item_7 = ListItem(List=text_split_4, Index=1, Wrap=True)  # -> flatten(Item)
text_split_7 = TextSplit(Text=list_item_7, Separators=" ")
text_split_8 = TextSplit(Text=text_split_7, Separators="x")  # -> flatten(Result)
list_item_8 = ListItem(List=text_split_8, Index=0, Wrap=True)  # -> Item, Item1, Item2
list_item_9 = ListItem(List=text_split_6, Index=0, Wrap=True)  # -> Item, Item1, Item2
point = Point(dispatch.ListB)
list_length = ListLength(List=point)
series = Series(Start="0", Step=number_slider_4, Count=list_length)  # -> simplify(Series)
explode_tree = ExplodeTree(Data=series)  # -> Branch0, reverse(Branch1)
subtraction = Subtraction(A=list_item_8.Item1, B=list_item_8.Item2)
subtraction_2 = Subtraction(A=list_item_9.Item1, B=list_item_9.Item2)
entwine = Entwine(Branch00=explode_tree.Branch0, Branch01=explode_tree.Branch1, FlattenInputs=True)
unit_z_3 = UnitZ(Factor=entwine)
circle = Circle(Plane=PlaneXY(0, 0, 0), Radius=expr("x/2000", list_item_8.Item1))
circle_2 = Circle(Plane=PlaneXY(0, 0, 0), Radius=expr("x/2000", subtraction))
circle_3 = Circle(Plane=PlaneXY(0, 0, 0), Radius=expr("x/2000", list_item_9.Item1))
circle_4 = Circle(Plane=PlaneXY(0, 0, 0), Radius=expr("x/2000", subtraction_2))
panel_2 = Panel(entwine)
move_2 = Move(Geometry=point, Motion=unit_z_3)  # -> Geometry, Transform
ruled_surface = RuledSurface(CurveA=circle_3, CurveB=circle_4)
ruled_surface_2 = RuledSurface(CurveA=circle, CurveB=circle_2)
panel_3 = Panel("""0
1""")
area = Area(Geometry=ruled_surface_2)  # -> Area, Centroid
area_2 = Area(Geometry=ruled_surface)  # -> Area, Centroid
dispatch_2 = Dispatch(List=divide_curve_2.Points, DispatchPattern=panel_3)  # -> ListA, ListB
list_item_10 = ListItem(List=flatten(divide_curve_2.Points), Index=0, Wrap=True)  # -> Item1, Item
list_item_11 = ListItem(List=flatten(move_2.Geometry), Index=0, Wrap=True)  # -> Item1, Item
shift_list = ShiftList(List=move_2.Geometry, Shift=1, Wrap=False)
section_1_a_mm2 = Panel(area_2.Area)
section_2_a_mm2 = Panel(area.Area)
point_2 = Point(dispatch_2.ListA)
text_split_9 = TextSplit(Text=list_item_6.Item, Separators=" ")  # -> flatten(Result)
text_split_10 = TextSplit(Text=list_item_7, Separators=" ")  # -> flatten(Result)
polyline = PolyLine(Vertices=divide_curve_2.Points, Closed=False)
polyline_2 = PolyLine(Vertices=move_2.Geometry, Closed=False)
curve = Curve(polyline_2)
explode = Explode(Curve=curve, Recursive=True)  # -> flatten(Segments), Vertices
line_to_beam_karamba3d = LineToBeamKaramba3D(Line=explode.Segments, Identifier="LOAD", New=True, Remove=True, LimitDistance_m=0.005)  # -> Element, Points, Info
line_2 = Line(StartPoint=[list_item_10.Item1, list_item_10.Item], EndPoint=[list_item_11.Item1, list_item_11.Item])
line_3 = Line(StartPoint=point_2, EndPoint=move_2.Geometry)
line_4 = Line(StartPoint=shift_list, EndPoint=point_2)
text_split_11 = TextSplit(Text=text_split_9, Separators=" x")  # -> flatten(Result)
text_split_12 = TextSplit(Text=text_split_10, Separators=" x")  # -> flatten(Result)
curve_2 = Curve(polyline)
curve_3 = Curve(flatten([curve_2, line_2]))
explode_2 = Explode(Curve=curve_3, Recursive=True)  # -> flatten(Segments), Vertices
line_to_beam_karamba3d_2 = LineToBeamKaramba3D(Line=explode_2.Segments, Identifier="OUT", New=True, Remove=True, LimitDistance_m=0.005)  # -> Element, Points, Info
merge = Merge(Data1=curve_2, Data2=line_2, Data3=polyline_2)
merge_2 = Merge(Data1=line_3, Data2=line_4)
curve_4 = Curve(flatten(merge_2))
explode_3 = Explode(Curve=curve_4, Recursive=True)  # -> flatten(Segments), Vertices
line_to_beam_karamba3d_3 = LineToBeamKaramba3D(Line=explode_3.Segments, Identifier="IN", New=True, Remove=True, LimitDistance_m=0.005)  # -> Element, Points, Info
merge_3 = Merge(Data1=flatten(merge), Data2=flatten(merge_2))  # -> flatten(Result)
sort_duplicate_points = SortDuplicatePoints(Points=[line_to_beam_karamba3d_2.Points, line_to_beam_karamba3d_3.Points, line_to_beam_karamba3d.Points])  # -> UniquePoints, Indices
list_length_2 = ListLength(List=merge_3)
panel_4 = Panel(list_length_2)
assemble_model_karamba3d = AssembleModelKaramba3D(
    Point=sort_duplicate_points.UniquePoints,
    Elem=[line_to_beam_karamba3d_2.Element, line_to_beam_karamba3d_3.Element, line_to_beam_karamba3d.Element],
    Support=[support_karamba3d, support_karamba3d_2],
    Load=[loads_karamba3d_2, loads_karamba3d],
    CrossSection=[list_item, list_item_3, list_item_2],
    Material=material_selection_karamba3d,
    LimitDistance_m=0.005)  # -> Model, Info, Mass_kg, CenterOfGravity
analyze_karamba3d = AnalyzeKaramba3D(Model=assemble_model_karamba3d.Model)  # -> CalculatedModel, MaximumDisplacement_cm, ResultingForceOfGravity_kN, ElasticEnergy_kNm
model_view_karamba3d = ModelViewKaramba3D(Model=analyze_karamba3d.CalculatedModel, ResultFactors=1, ResultCase=-1)  # -> Model, DeformedMesh, DeformedAxes, DeformedModel
beam_view_karamba3d = BeamViewKaramba3D(Model=model_view_karamba3d.Model)  # -> Model, MeshesOfRenderedBeams, DeformedBeamAxes, LegendColors, LegendTags

b_forces = BeamForcesKaramba3D(
    AnalyzedModel=beam_view_karamba3d.Model,
    BeamIdentifiers=["LOAD", "OUT"],
    LCase=-1,
    MaximumDistanceBetweenResults_m=-1,
    NumberOfResultsPerBeamElement=2)  # -> AnalyzedModel, NormalForce_kN, ShearForceVz_kN, ShearForceVy_kN, BendingMomentMt_kNm, BendingMomentMy_kNm, BendingMomentMz_kNm
abs = Absolute(Value=b_forces.NormalForce_kN)  # -> flatten(Result)

b_forces_2 = BeamForcesKaramba3D(
    AnalyzedModel=beam_view_karamba3d.Model,
    BeamIdentifiers="IN",
    LCase=-1,
    MaximumDistanceBetweenResults_m=-1,
    NumberOfResultsPerBeamElement=2)  # -> AnalyzedModel, NormalForce_kN, ShearForceVz_kN, ShearForceVy_kN, BendingMomentMt_kNm, BendingMomentMy_kNm, BendingMomentMz_kNm
abs_2 = Absolute(Value=b_forces_2.NormalForce_kN)  # -> flatten(Result)
list_item_12 = ListItem(List=text_split_11, Index=0, Wrap=True)  # -> Item, Item1
list_item_13 = ListItem(List=text_split_12, Index=0, Wrap=True)  # -> Item, Item1
number_slider_7 = Slider(0.05, range=0..0.1)
division = Division(A=list_item_12.Item1, B=1000)
division_2 = Division(A=list_item_13.Item1, B=1000)

sort_list = SortList(Keys=abs)  # -> reverse(Keys), ValuesValuesA
list_item_14 = ListItem(List=sort_list.Keys, Index=0, Wrap=True)
panel_5 = Panel(sort_list.Keys)
expression = Expression(x=list_item_14, Expression="Format(\"Max axial force is {0:0.0} kN\", x)")

sort_list_2 = SortList(Keys=abs_2)  # -> reverse(Keys), ValuesValuesA
pipe = Pipe(Curve=flatten(merge_2), Radius=expr("x/2", division_2), Caps=0)  # -> flatten(Pipe)
pipe_2 = Pipe(Curve=flatten(merge), Radius=expr("x/2", division), Caps=0)  # -> flatten(Pipe)
settings_custom = SettingsCustom(
    StitchSeams=True,
    SimplePlanes=False,
    Refine=True,
    MinCount=16,
    MaxCount=400,
    AspectRatio=20,
    MaxDistance=0,
    MaxAngle=20,
    MinEdge=number_slider_7,
    MaxEdge=number_slider_7)
list_item_15 = ListItem(List=sort_list_2.Keys, Index=0, Wrap=True)
mesh_brep = MeshBrep(Brep=[pipe, pipe_2], Settings=settings_custom)

# ---- group: F/A
division_3 = Division(A=list_item_14, B=area_2.Area)
division_4 = Division(A=list_item_15, B=area.Area)

# ----
mesh = Mesh(beam_view_karamba3d.MeshesOfRenderedBeams)
mesh_join = MeshJoin(Meshes=mesh_brep)
mesh_join_2 = MeshJoin(Meshes=mesh)
panel_6 = Panel(division_3)
panel_7 = Panel(division_4)

# ---- group: F/A to Fy
division_5 = Division(A=panel_6, B="235000")
division_6 = Division(A=panel_7, B="235000")

# ----
pick_n_choose = PickNChoose(Pattern=boolean_toggle, Stream0=mesh_join, Stream1=mesh_join_2)
panel_8 = Panel(division_5)
panel_9 = Panel(division_6)

# ---- group: RH_OUT:mesh
mesh_2 = Mesh(pick_n_choose)

# ---- group: RH_OUT:edges
medges = MeshEdges(Mesh=mesh_2)  # -> NakedEdges, InteriorEdges, NonManifoldEdges

# ---- group: RH_OUT:MaxAxial
data = Data(expression)

# ---- group: RH_OUT:CrossSection1
data_2 = Data(list_item_6.Item)

# ---- group: RH_OUT:CrossSection2
data_3 = Data(list_item_7)

# ----
maximum = Maximum(A=division_5, B=division_6)
panel_10 = Panel(data)
panel_11 = Panel(data_2)
panel_12 = Panel(data_3)
multiplication = Multiplication(A=maximum, B=100)
expression_2 = Expression(x=multiplication, Expression="Format(\"Max utilization is {0:0.0} %\", x)")

# ---- group: RH_OUT:Utilization
data_4 = Data(expression_2)

# ----
panel_13 = Panel(data_4)
